# Grasshopper definition 20200506_v3_Looped_stairs_Github_Version.gh (Grasshopper 1.0.7)
# plug-ins: NGon 2.1

# ---- group: Adjusting Location of the base
number_slider = Slider(0.123, range=-1..1)
number_slider_2 = Slider(0.109, range=-1..1)
number_slider_3 = Slider(0.086, range=-1..1)
number_slider_4 = Slider(0.138, range=-1..1)
number_slider_5 = Slider(0.379, range=-1..1)
number_slider_6 = Slider(0.059, range=-1..3)

# ---- group: Previously tried curves (not working)
crv3_based4 = Curve(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)
crv3_based4_2 = Curve(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)
crv3_based = Curve(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)
crv3_based3 = Curve(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)
crv3_based4_3 = Curve(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)
crv3_based2 = Curve(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)
crv1 = Curve(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)  # disabled
crv2 = Curve(<curve referenced from the Rhino model>)  # disabled
crv5x = Curve(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)  # disabled
crv5x_2 = Curve(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)  # disabled

# ---- group: Comments on exluding previous solutions
# Based on crv3: we need to add 13 steps before hitting (from top)
# Crv3: we need to add a small entrance to left (confined)
# Crv5: not that spontaneous (curve then smooth curve)
based_on_crv3 = Curve(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)
crv3 = Curve(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)
crv5x_3 = Curve(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)

# ----
crv5 = Curve(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)
number_slider_7 = Slider(0.99, range=0.5..0.99)
crv = Curve(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)
crv_2 = Curve(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)

number_slider_8 = Slider(4.43, range=0..10)
number_slider_9 = Slider(0.77, range=0..1)
eval = Evaluate(F="x/y", x=number_slider_8, y=Slider(25, range=0..100))
scale = Scale(Geometry=crv3_based4, Center=Point(0, 0, 0), Factor=Slider(0.6, range=0..1))  # -> Geometry, Transform
width = Slider(1.2, range=0..10)

crv_3 = Curve(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)

# ---- group: Top constraint, the opening and the beams
eval_2 = Evaluate(F="(x - 1.32)", x=number_slider_8)
xy = XYPlane(Origin=Point(0, 0, 0))
Z = UnitZ(Factor=number_slider_8)
Z_2 = UnitZ(Factor=eval_2)
move = Move(Geometry=xy, Motion=Z_2)  # -> Geometry, Transform
move_2 = Move(Geometry=xy, Motion=Z)  # -> Geometry, Transform
rectangle = Rectangle(Plane=PlaneXY(0, 0, 0), XSize=Domain(-2.1, 2.1), YSize=Domain(-2.1, 2.1), Radius=0)  # -> Rectangle, Length
rectangle_2 = Rectangle(Plane=move.Geometry, XSize=Domain(-1.415, 1.415), YSize=Domain(-1.415, 1.415), Radius=0)  # -> Rectangle, Length
rectangle_3 = Rectangle(Plane=move_2.Geometry, XSize=Domain(-2.1, 2.1), YSize=Domain(-2.1, 2.1), Radius=0)  # -> Rectangle, Length
rectangle_4 = Rectangle(Plane=move_2.Geometry, XSize=Domain(-1.415, 1.415), YSize=Domain(-1.415, 1.415), Radius=0)  # -> Rectangle, Length
rectangle_5 = Rectangle(Plane=PlaneXY(0, 0, 0), XSize=Domain(-1.415, 1.415), YSize=Domain(-1.415, 1.415), Radius=0)  # -> Rectangle, Length
merge = Merge(Data1=rectangle_2.Rectangle, Data2=rectangle_4.Rectangle)
merge_2 = Merge(Data1=rectangle_3.Rectangle, Data2=rectangle_4.Rectangle)
loft = Loft(Curves=merge_2, Options={Adjust=False, Closed=False, LoftEnds=0, LoftSimp=0, LoftType=0, Rebuild=10, Refit=0.01})
loft_2 = Loft(Curves=merge, Options={Adjust=False, Closed=False, LoftEnds=0, LoftSimp=0, LoftType=0, Rebuild=10, Refit=0.01})
Z_3 = UnitZ(Factor=-0.24)
extr = Extrude(Base=loft, Direction=Z_3)

# ----
scale_2 = Scale(Geometry=crv, Center=Point(0, 0, 0), Factor=number_slider_7)  # -> Geometry, Transform
scale_3 = Scale(Geometry=crv_2, Center=Point(0, 0, 0), Factor=number_slider_7)  # -> Geometry, Transform
scale_4 = Scale(Geometry=crv_3, Center=Point(0, 0, 0), Factor=Slider(0.866, range=0.5..0.99))  # -> Geometry, Transform

X = UnitX(Factor=number_slider_3)
Y = UnitY(Factor=number_slider)
move_3 = Move(Geometry=scale_3.Geometry, Motion=X)  # -> Geometry, Transform
move_4 = Move(Geometry=move_3.Geometry, Motion=Y)  # -> Geometry, Transform

Y_2 = UnitY(Factor=number_slider_4)
X_2 = UnitX(Factor=number_slider_6)
move_5 = Move(Geometry=scale_2.Geometry, Motion=X_2)  # -> Geometry, Transform
move_6 = Move(Geometry=move_5.Geometry, Motion=Y_2)  # -> Geometry, Transform
offset = OffsetCurve(Curve=move_6.Geometry, Distance=Slider(0.17, range=-1..1), Plane=PlaneXY(0, 0, 0), Corners=0)

X_3 = UnitX(Factor=number_slider_5)
Y_3 = UnitY(Factor=number_slider_2)
move_7 = Move(Geometry=scale_4.Geometry, Motion=X_3)  # -> Geometry, Transform
move_8 = Move(Geometry=move_7.Geometry, Motion=Y_3)  # -> Geometry, Transform
offset_2 = OffsetCurve(Curve=move_8.Geometry, Distance=Slider(0.01, range=-1..1), Plane=PlaneXY(0, 0, 0), Corners=0)

move_9 = Move(Geometry=move_4.Geometry, Motion=Vector(0, 0, 10))  # -> Geometry, Transform

# ---- group: Doesnt Work Properly in curved stairs!!, need to recreate a new definition based on our case!!
width_2 = Slider(1.2, range=0..10)
stair = Stair(curve=scale.Geometry, side=Toggle(True), height=number_slider_8, step_h=eval, width=width_2)  # -> step, E, C, platform, height_2; disabled

# ----
Z_4 = UnitZ(Factor=0.15)

rotate = Rotate(Geometry=move_9.Geometry, Angle=degrees(Slider(0, range=-180..180)), Plane=PlaneXY(0, 0, 0))  # -> Geometry, Transform
crv_4 = Curve(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)
boundary = BoundarySurfaces(Edges=crv_4)
extr_2 = Extrude(Base=boundary, Direction=Z_4)

crv_5 = Curve(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)

Z_5 = UnitZ(Factor=0.15)
rotate_2 = Rotate(Geometry=offset_2, Angle=degrees(Slider(60, range=-180..180)), Plane=PlaneXY(0, 0, 0))  # -> Geometry, Transform
boundary_2 = BoundarySurfaces(Edges=crv_5)
extr_3 = Extrude(Base=boundary_2, Direction=Z_5)

curve = Curve(simplify(graft(scale.Geometry)))
width_3 = Number(graft(width))
floor_height = Data(number_slider_8)
step_height = Data(eval)

# ---- group: other blob shaped base past solutions
crv_6 = Curve(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)
crv_7 = Curve(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)

# ---- group: Number of steps
division = Division(A=floor_height, B=step_height)

# ---- group: blob shaped based
crv_8 = Curve(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)

# ----
project = Project(Geometry=crv_8, Plane=PlaneXY(0, 0, 0))  # -> Geometry, Transform

Z_6 = UnitZ(Factor=0.15)
rotate_3 = Rotate(Geometry=offset, Angle=degrees(Slider(-81, range=-180..180)), Plane=PlaneXY(0, 0, 0))  # -> Geometry, Transform
boundary_3 = BoundarySurfaces(Edges=project.Geometry)
extr_4 = Extrude(Base=boundary_3, Direction=Z_6)

int = Integer(division)

# ---- group: Step Riser
division_2 = Division(A=floor_height, B=int)

# ----
range = Range(Domain=floor_height, Steps=int)
curvepoint = PointOnCurve(curve, parameter=0.881)
curveshatter = CurveShatter(Curve=reparameterize(curve), Points=curvepoint, Tolerance=0.01)

A = Data(extr_2)
C = Data(extr_4)
B = Data(extr_3)

item = ListItem(List=curveshatter, Index=0, Wrap=True)  # -> Item, Item1
Z_7 = UnitZ(Factor=range)
merge_3 = Merge(Data1=A, Data2=B, Data3=C)
data = Data(item.Item1)
divide = DivideCurve(Curve=reparameterize(item.Item), Count=int, Kinks=False, UseTasks=True)  # -> Points, Tangents, Parameters

graph = GraphMapper(
    simplify(divide.Parameters),
    x0=0,
    x1=1,
    y0=0,
    y1=1,
    container_name="Bezier",
    cpx=[0, 0.1338793933, 0.4069116116, 1],
    cpy=[0, 0.09459120035, 0.6791381836, 1])

cluster = Cluster(L_2=graph, L=graph, i=Slider(12, range=11..20), L_3=graph)
item_2 = ListItem(List=Z_7, Index=0, Wrap=True)  # -> Item1, Item
eval_3 = EvaluateCurve(Curve=reparameterize(item.Item), Parameter=cluster)  # -> Point, Tangent, Angle
move_10 = Move(Geometry=simplify(data), Motion=simplify(item_2.Item1))  # -> Geometry, Transform
move_11 = Move(Geometry=simplify(eval_3.Point), Motion=simplify(Z_7))  # -> Geometry, Transform
intcrv = Interpolate(Vertices=move_11.Geometry, Degree=3, Periodic=False, KnotStyle=1)  # -> simplify(Curve), Length, Domain
merge_4 = Merge(Data1=intcrv.Curve, Data2=move_10.Geometry)
xy_2 = XYPlane(Origin=Point(0, 0, 0))
rectangle_6 = Rectangle(Plane=PlaneXY(0, 0, 0), XSize=Domain(-5, 5), YSize=Domain(-5, 5), Radius=0)  # -> Rectangle, Length
boundary_4 = BoundarySurfaces(Edges=rectangle_6.Rectangle)
join = JoinCurves(Curves=flatten(merge_4), Preserve=False)  # -> simplify(Curves)
offset_3 = Offset(Curve=flatten(join), Distance=width_3, Plane=xy_2, Corners=1)  # -> simplify(Curve)
project_2 = Project(Geometry=offset_3, Plane=PlaneXY(0, 0, 0))  # -> Geometry, Transform
curvepoint_2 = PointOnCurve(project_2.Geometry, parameter=0.957)
curveshatter_2 = CurveShatter(Curve=reparameterize(project_2.Geometry), Points=curvepoint_2, Tolerance=0.01)  # -> flatten(Curves)
item_3 = ListItem(List=curveshatter_2, Index=0, Wrap=True)  # -> Item, Item1
divide_2 = DivideCurve(Curve=reparameterize(item_3.Item), Count=int, Kinks=False, UseTasks=True)  # -> Points, Tangents, Parameters
move_12 = Move(Geometry=simplify(item_3.Item1), Motion=simplify(item_2.Item1))  # -> Geometry, Transform
move_13 = Move(Geometry=simplify(divide_2.Points), Motion=simplify(Z_7))  # -> Geometry, Transform
end = EndPoints(Curve=move_12.Geometry)  # -> Start, End
intcrv_2 = Interpolate(Vertices=move_13.Geometry, Degree=3, Periodic=False, KnotStyle=1)  # -> simplify(Curve), Length, Domain
merge_5 = Merge(Data1=intcrv_2.Curve, Data2=move_12.Geometry)
move_14 = Move(Geometry=boundary_4, Motion=Z_7)  # -> Geometry, Transform
join_2 = JoinCurves(Curves=merge_5, Preserve=False)  # -> simplify(Curves)

panel = Panel(division_2)
Z_8 = UnitZ(Factor=panel)

pcx = CurvePlane(Curve=join, Plane=move_14.Geometry)  # -> Points, ParamsC, ParamsP
pcx_2 = CurvePlane(Curve=join_2, Plane=move_14.Geometry)  # -> Points, ParamsC, ParamsP
ln = Line(StartPoint=pcx.Points, EndPoint=pcx_2.Points)  # -> simplify(flatten(Line))
md_slider = MDSlider(SliderMode=0, slider_value=Point(0, 0, 0.5), x_domain=Domain(0, 1), y_domain=Domain(0, 1), z_domain=Domain(0, 1))
extr_5 = Extrude(Base=ln, Direction=Z_8)
evalsrf = EvaluateSurface(Surface=extr_5, Point=md_slider)  # -> Point, Normal, UDirection, VDirection, Frame
item_4 = ListItem(List=range, Index=0, Wrap=True)  # -> Item1, Item
pdecon = Deconstruct(Point=evalsrf.Point)  # -> XComponent, YComponent, ZComponent
loft_3 = Loft(Curves=extr_5, Options={Adjust=False, Closed=False, LoftEnds=0, LoftSimp=0, LoftType=0, Rebuild=10, Refit=0.01})
equals = Equality(FirstNumber=pdecon.ZComponent, SecondNumber=item_4.Item1)  # -> Equality, Inequality
bbx = BrepBrep(BrepA=loft_3, BrepB=move_14.Geometry)  # -> simplify(flatten(Curves)), Points
dispatch = Dispatch(List=extr_5, DispatchPattern=equals.Equality)  # -> ListA, ListB
item_5 = ListItem(List=dispatch.ListA, Index=0, Wrap=True)  # -> Item1, Item
item_6 = ListItem(List=evalsrf.Normal, Index=0, Wrap=True)  # -> Item1, Item
item_7 = ListItem(List=extr_5, Index=0, Wrap=True)  # -> Item2, Item1, Item
boundary_5 = BoundarySurfaces(Edges=bbx.Curves)
neg = Negative(Value=Z_8)
amp = Amplitude(Vector=item_6.Item1, Amplitude=Slider(0.75, range=0.1..2))
loft_4 = Loft(
    Curves=[item_7.Item2, item_7.Item1],
    Options={Adjust=False, Closed=False, LoftEnds=0, LoftSimp=0, LoftType=0, Rebuild=10, Refit=0.01})
lng = ListLength(List=dispatch.ListA)
extr_6 = Extrude(Base=boundary_5, Direction=neg)
move_15 = Move(Geometry=item_5.Item1, Motion=amp)  # -> Geometry, Transform
subtraction = Subtraction(A=lng, B=1)
replace = ReplaceItems(List=dispatch.ListA, Item=move_15.Geometry, Indices=subtraction, Wrap=False)
loft_5 = Loft(Curves=replace, Options={Adjust=False, Closed=False, LoftEnds=0, LoftSimp=0, LoftType=0, Rebuild=10, Refit=0.01})
cap = CapHoles(Brep=loft_5)
ins = InsertItems(List=extr_5, Item=move_15.Geometry, Indices=-1, Wrap=True)
merge_6 = Merge(Data1=intcrv.Curve, Data2=intcrv_2.Curve)  # -> flatten(Result)
merge_7 = Merge(Data1=move_10.Geometry, Data2=move_12.Geometry)  # -> flatten(Result)
join_3 = BrepJoin(Breps=flatten([extr_6, cap]))  # -> Breps, Closed
loft_6 = Loft(Curves=ins, Options={Adjust=False, Closed=False, LoftEnds=0, LoftSimp=0, LoftType=0, Rebuild=10, Refit=0.01})
end_2 = EndPoints(Curve=merge_7)  # -> Start, End
debrep = DeconstructBrep(Brep=loft_6)  # -> Faces, Edges, Vertices
move_16 = Move(Geometry=end_2.End, Motion=amp)  # -> Geometry, Transform
panel_2 = Panel("""0
0
1
1""")
ln_2 = Line(StartPoint=end_2.Start, EndPoint=move_16.Geometry)
area = Area(Geometry=debrep.Faces)  # -> Area, Centroid

data_2 = Data(graft(merge_6))
data_3 = Data(graft(ln_2))
loft_7 = Loft(Curves=merge_6, Options={Adjust=False, Closed=False, LoftEnds=0, LoftSimp=0, LoftType=0, Rebuild=10, Refit=0.01})
loft_8 = Loft(Curves=ln_2, Options={Adjust=False, Closed=False, LoftEnds=0, LoftSimp=0, LoftType=0, Rebuild=10, Refit=0.01})

sort = SortList(Keys=area.Area, ValuesA=debrep.Faces)  # -> Keys, ValuesA
dispatch_2 = Dispatch(List=sort.ValuesA, DispatchPattern=panel_2)  # -> ListA, ListB
area_2 = Area(Geometry=dispatch_2.ListA)  # -> Area, Centroid
Z_9 = UnitZ(Factor=Z_8)
pdecon_2 = Deconstruct(Point=area_2.Centroid)  # -> XComponent, YComponent, ZComponent
neg_2 = Negative(Value=Z_9)
move_17 = Move(Geometry=loft_7, Motion=neg_2)  # -> Geometry, Transform
sort_2 = SortList(Keys=pdecon_2.ZComponent, ValuesA=dispatch_2.ListA)  # -> Keys, ValuesA
item_8 = ListItem(List=sort_2.ValuesA, Index=0, Wrap=True)  # -> Item, Item1
debrep_2 = DeconstructBrep(Brep=item_8.Item1)  # -> Faces, simplify(Edges), Vertices
len = Length(Curve=debrep_2.Edges)
sort_3 = SortList(Keys=len, ValuesA=debrep_2.Edges)  # -> Keys, ValuesA
multiplication = Multiplication(A=Z_8, B=-2)
item_9 = ListItem(List=sort_3.ValuesA, Index=0, Wrap=True)  # -> Item2, Item1, Item
merge_8 = Merge(Data1=item_9.Item2, Data2=item_9.Item1)  # -> simplify(graft(Result))
move_18 = Move(Geometry=item_8.Item, Motion=neg_2)  # -> Geometry, Transform
extr_7 = Extrude(Base=merge_8, Direction=multiplication)
railing_height = Slider(1, range=0.3..1.5)
Z_10 = UnitZ(Factor=railing_height)
move_19 = Move(Geometry=merge_8, Motion=Z_10)  # -> simplify(Geometry), Transform

# ---- group: Radius of Top rail
number_slider_10 = Slider(0.02, range=0..0.1)

# ----
pframe = PerpFrame(Curve=move_19.Geometry, Parameter=0)
number_slider_11 = Slider(0.014, range=0..0.2)
offset_4 = OffsetSurface(Surface=extr_7, Distance=number_slider_11, Retrim=True)
loft_9 = Loft(
    Curves=[offset_4, extr_7],
    Options={Adjust=False, Closed=False, LoftEnds=0, LoftSimp=0, LoftType=0, Rebuild=10, Refit=0.01})
join_4 = BrepJoin(Breps=[loft_9, offset_4, extr_7])  # -> Breps, Closed
cir = Circle(Plane=pframe, Radius=number_slider_10)
loft_10 = Loft(
    Curves=[move_19.Geometry, merge_8],
    Options={Adjust=False, Closed=False, LoftEnds=0, LoftSimp=0, LoftType=0, Rebuild=10, Refit=0.01})
swp1 = Sweep1(Rail=move_19.Geometry, Sections=cir, Miter=1)
offset_5 = OffsetSurface(Surface=loft_10, Distance=number_slider_11, Retrim=True)
Z_11 = UnitZ(Factor=Slider(-0.03, range=-0.05..-0.01))
extr_8 = Extrude(Base=loft_8, Direction=Z_11)
extr_9 = Extrude(Base=move_17.Geometry, Direction=Z_11)
merge_9 = Merge(Data1=extr_9, Data2=extr_8)
extr_10 = Extrude(Base=move_18.Geometry, Direction=Z_11)
loft_11 = Loft(
    Curves=[offset_5, loft_10],
    Options={Adjust=False, Closed=False, LoftEnds=0, LoftSimp=0, LoftType=0, Rebuild=10, Refit=0.01})
bottom = Data(extr_10)
join_5 = BrepJoin(Breps=[loft_11, loft_10, offset_5])  # -> Breps, Closed
railing = Data(swp1)
baluster = Data(join_5.Breps)
bottom_2 = Data(merge_9)
stairs = Data(join_3.Breps)
supports = Data(join_4.Breps)

trim_flatten = TrimFlatten(T=join_3.Breps, D=1)
edges = BrepEdges(Brep=trim_flatten)  # -> flatten(Naked), Interior, NonManifold
preview = CustomPreview(Geometry=[edges.Interior, edges.NonManifold], Shader=ColourSwatch(SwatchColor=RGB(217, 78, 78)))

merge_10 = Merge(
    Data1=simplify(flatten(stairs)),
    Data2=railing,
    Data3=flatten(baluster),
    Data4=bottom_2,
    Data5=simplify(flatten(supports)))  # -> simplify(Result)
Z_12 = UnitZ(Factor=Slider(0.45, range=0..1))
move_20 = Move(Geometry=bottom_2, Motion=Z_12)  # -> Geometry, Transform
move_21 = Move(Geometry=supports, Motion=Z_12)  # -> Geometry, Transform
move_22 = Move(Geometry=baluster, Motion=Z_12)  # -> Geometry, Transform
move_23 = Move(Geometry=stairs, Motion=Z_12)  # -> Geometry, Transform
move_24 = Move(Geometry=railing, Motion=Z_12)  # -> Geometry, Transform
move_25 = Move(Geometry=merge_10, Motion=Z_12)  # -> Geometry, Transform
full_stairs = Data(move_25.Geometry)

# ---- group: Stairs Decomposed
supports_2 = Data(move_21.Geometry)
baluster_2 = Data(move_22.Geometry)
bottom_3 = Data(move_20.Geometry)
railing_2 = Data(move_24.Geometry)
stairs_2 = Data(move_23.Geometry)

# ==== cluster TrimFlatten: Trim or Flatten
T = ClusterInput()
D = ClusterInput()
T_2 = Data(T)
D_2 = Integer(D)
trim = TrimTree(Tree=T_2, Depth=D_2)
tstat = TreeStatistics(Tree=trim)  # -> Paths, Length, Count
flip = FlipMatrix(Data=T_2)  # disabled
flatten = FlattenTree(Tree=T_2, Path="{0}")
null = NullItem(Item=tstat.Count)  # -> NullFlags, InvalidFlags, Description
filter = StreamFilter(Gate=null.NullFlags, Stream0=trim, Stream1=flatten)
T_3 = Data(filter)
T_4 = ClusterOutput(T_3)

# ==== cluster Stair: Generate Stair Based on Curve
curve = ClusterInput()  # Base Curve for Stair
width = ClusterInput()  # Stair Width
side = ClusterInput()  # 0 - right side, 1 - left side
step_h = ClusterInput()  # Step height
height = ClusterInput()  # Total Height
楼梯线 = Curve(simplify(graft(curve)))
左边线 = Boolean(side)
宽度 = Number(graft(width))
flip = FlipCurve(Curve=楼梯线, Guide=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)  # -> Curve, Flag
neg = Negative(Value=宽度)
p_n_c = PickNChoose(Pattern=flip.Flag, Stream0=neg, Stream1=宽度)
xor = GateXor(A=flip.Flag, B=左边线)
offset = OffsetCurve(Curve=楼梯线, Distance=p_n_c, Plane=PlaneXY(0, 0, 0), Corners=1)  # -> simplify(graft(Curve))
p_n_c_2 = PickNChoose(Pattern=xor, Stream0=offset, Stream1=楼梯线)
内边线 = Curve(simplify(graft(p_n_c_2)))
最大踢面高 = Number(simplify(graft(step_h)))
总高度 = Number(simplify(graft(height)))
explode = Explode(Curve=内边线, Recursive=True)  # -> simplify(Segments), Vertices
division = Division(A=总高度, B=最大踢面高)
len = Length(Curve=explode.Segments)
ma = MassAddition(Input=len)  # -> Result, PartialResults
division_2 = Division(A=len, B=ma.Result)
int = Integer(division)
division_3 = Division(A=总高度, B=int)
multiplication = Multiplication(A=division, B=division_2)
阶数 = Integer(multiplication)
multiplication_2 = Multiplication(A=阶数, B=division_3)
multiplication_3 = Multiplication(A=阶数, B=division_3)
ma_2 = MassAddition(Input=multiplication_2)  # -> Result, PartialResults
ins = InsertItems(List=ma_2.PartialResults, Item=0, Indices=0, Wrap=True)
range = Range(Domain=multiplication_3, Steps=阶数)
cull_i = CullIndex(List=ins, Indices=-1, Wrap=True)
Z = UnitZ(Factor=range)
Z_2 = UnitZ(Factor=cull_i)
move = Move(Geometry=simplify(explode.Segments), Motion=simplify(Z_2))  # -> Geometry, Transform
divide = DivideCurve(Curve=move.Geometry, Count=阶数, Kinks=False, UseTasks=True)  # -> Points, Tangents, Parameters
panel = Panel(division_3)
move_2 = Move(Geometry=simplify(divide.Points), Motion=simplify(Z))  # -> Geometry, Transform
height_2 = ClusterOutput(division_3)  # Actual Height of step
intcrv = Interpolate(Vertices=move_2.Geometry, Degree=3, Periodic=False, KnotStyle=1)  # -> simplify(Curve), Length, Domain
graft = GraftTree(Tree=move.Geometry, IncludeEmptyLists=True, IncludeNullItems=True)  # -> simplify(Tree)
combine = CombineData(Input0=intcrv.Curve, Input1=graft)  # -> Result, Index
crv = Curve(simplify(graft(combine.Result)))
neg_2 = Negative(Value=simplify(p_n_c))
trim_flip = TrimFlatten(T=crv, D=1)
xy = XYPlane(Origin=Point(0, 0, 0))
offset_2 = Offset(Curve=trim_flip, Distance=neg_2, Plane=xy, Corners=1)  # -> simplify(Curve)
shift = ShiftList(List=trim_flip, Shift=1, Wrap=invert(True))  # -> graft(List)
ins_2 = InsertItems(List=crv, Item=offset_2, Indices=-1, Wrap=True)  # -> simplify(List)
end = EndPoints(Curve=shift)  # -> Start, End
trim_flip_2 = TrimFlatten(T=offset_2, D=1)
trim_flip_3 = TrimFlatten(T=offset_2, D=1)
end_2 = EndPoints(Curve=ins_2)  # -> Start, End
pdecon = Deconstruct(Point=end.Start)  # -> XComponent, YComponent, ZComponent
pline = PolyLine(Vertices=end_2.Start, Closed=False)
shift_2 = ShiftList(List=trim_flip_3, Shift=-1, Wrap=invert(True))  # -> graft(List)
shift_3 = ShiftList(List=trim_flip_2, Shift=1, Wrap=invert(True))  # -> graft(List)
Z_3 = UnitZ(Factor=pdecon.ZComponent)
Z_4 = UnitZ(Factor=panel)  # -> simplify(UnitVector)
end_3 = EndPoints(Curve=crv)  # -> Start, End
swp2 = Sweep2(Rail1=crv, Rail2=offset_2, Sections=pline, SameHeight=False)
trim_flatten = TrimFlatten(T=simplify(end_3.Start), D=1)
neg_3 = Negative(Value=Z_4)
project = Project(Geometry=shift_3, Plane=Z_3)  # -> Geometry, Transform
project_2 = Project(Geometry=shift_2, Plane=Z_3)  # -> Geometry, Transform
extr = Extrude(Base=swp2, Direction=neg_3)
trim_flatten_2 = TrimFlatten(T=simplify(extr), D=1)
len_2 = Length(Curve=project_2.Geometry)  # -> expr("x*2", Length)
len_3 = Length(Curve=project.Geometry)  # -> expr("x*2", Length)
panel_2 = Panel(Z_4)
ext = ExtendCurve(Curve=project.Geometry, Type=0, Start=len_3, End=0)
ext_2 = ExtendCurve(Curve=project_2.Geometry, Type=0, Start=0, End=len_2)
end_4 = EndPoints(Curve=project.Geometry)  # -> Start, End
end_5 = EndPoints(Curve=project_2.Geometry)  # -> Start, End
contour = Contour(Shape=trim_flatten_2, Point=trim_flatten, Direction=Z_4, Distance=Z_4, UseTasks=False)  # -> simplify(Contours)
llx = LineLine(Line1=project.Geometry, Line2=project_2.Geometry)  # -> ParamA, ParamB, PointA, PointB
ccx = CurveCurve(CurveA=simplify(ext), CurveB=simplify(ext_2), UseTasks=False)  # -> Points, ParamsA, ParamsB
boundary = BoundarySurfaces(Edges=contour)
item = ListItem(List=ccx.Points, Index=0, Wrap=True)
combine_2 = CombineData(Input0=simplify(llx.PointA), Input1=simplify(item))  # -> Result, Index
extr_2 = Extrude(Base=boundary, Direction=neg_3)  # -> simplify(Extrusion)
srf4pt = _4PointSurface(CornerA=end_4.Start, CornerB=end.Start, CornerC=end_5.End, CornerD=combine_2.Result)
neg_4 = Negative(Value=panel)
Z_5 = UnitZ(Factor=neg_4)
move_3 = Move(Geometry=srf4pt, Motion=Z_5)  # -> Geometry, Transform
ln = Line(StartPoint=end_5.End, EndPoint=combine_2.Result)
ln_2 = Line(StartPoint=combine_2.Result, EndPoint=end_4.Start)
trim_flatten_3 = TrimFlatten(T=extr_2, D=1)
extr_3 = Extrude(Base=move_3.Geometry, Direction=Z_5)
join = JoinCurves(Curves=[ln, ln_2], Preserve=False)  # -> simplify(graft(Curves))
step = ClusterOutput(trim_flatten_3)  # Steps
platform = ClusterOutput(extr_3)  # Platform
simplify = CSharpScript(T=join)  # -> A; inputs T: tree
# ---------- simplify: C# ----------
    T.SimplifyPaths();
    A = T;
# ---------- end simplify ----------
merge = Merge(Data1=simplify(ins_2), Data2=simplify(graft(simplify)))
clean = CleanTree(RemoveNulls=True, RemoveInvalid=True, RemoveEmpty=invert(False), Tree=merge)
edges = BrepEdges(Brep=trim_flatten_3)  # -> Naked, Interior, NonManifold
trim_flatten_4 = TrimFlatten(T=clean, D=2)
preview = CustomPreview(Geometry=[edges.Naked, edges.Interior, edges.NonManifold], Shader=ColourSwatch(SwatchColor=RGB(0, 0, 0)))
join_2 = JoinCurves(Curves=trim_flatten_4, Preserve=False)  # -> simplify(Curves)
multiplication_4 = Multiplication(A=neg_3, B=2)
move_4 = Move(Geometry=join_2, Motion=multiplication_4)  # -> simplify(Geometry), Transform
C = ClusterOutput(join_2)
extr_4 = Extrude(Base=move_4.Geometry, Direction=expr("-x", multiplication_4))  # -> simplify(Extrusion)
E = ClusterOutput(extr_4)

# ==== cluster Cluster
L = ClusterInput()
i = ClusterInput()
L_2 = ClusterInput()
split = SplitList(List=L, Index=i)  # -> ListA, ListB
lng = ListLength(List=split.ListB)
item = ListItem(List=split.ListB, Index=0, Wrap=True)
index = ItemIndex(List=L_2, Item=split.ListB)
dom = ConstructDomain(DomainStart=item, DomainEnd=1)
subtraction = Subtraction(A=lng, B=1)
range = Range(Domain=dom, Steps=subtraction)
L_3 = ClusterInput()
replace = ReplaceItems(List=L_3, Item=range, Indices=index, Wrap=False)
L_4 = ClusterOutput(replace)
